# Dynamo graph Ponte_Saber.dyn (Dynamo 3.3.0.6316)

# group: Marcação de um elemento estrutural tipo Mastro
# Autor: Prof. José Luis Menegotto
# Escola Politécnica da UFRJ
largura = DoubleSlider(3, range=1..8 step 0.25)
profundidade = DoubleSlider(1, range=1..5 step 0.25)
altura = DoubleSlider(19.25, range=3..40 step 0.25)
c1_em_x = DoubleSlider(0.33, range=0.1..0.45 step 0.0025)
c2_em_y = DoubleSlider(0.45, range=0.1..0.45 step 0.0025)
simetria_x_1_simétrico = DoubleSlider(0.05, range=0.05..1 step 0.0025)
simetria_y_1_simétrico = DoubleSlider(0.4325, range=0.05..1 step 0.0025)
espessura_parede = DoubleSlider(0.15, range=0.05..0.5 step 0.05)
andar = Levels("Level 2")
seção_inferior_do_mastro = CodeBlock(l=largura, p=profundidade, h=altura, c1=c1_em_x, c2=c2_em_y, k=simetria_x_1_simétrico, j=simetria_y_1_simétrico, e=espessura_parede, and=andar)
# ---------- seção_inferior_do_mastro.designscript (26 lines) ----------
l;
p;
h;
m = 0.50;
c1;
c2;
k;
j;
e;
and;
par = "Elevation";
i   = [1,2,3,9,14,19,-2,-3,-4,15,10,5];
FamilyInstance.SetParameterByName(and, par, h);
//------------------------------------
x   = l * [ -m,-c1  ,0,c1*k,m ];
y   = p * [ -m,-c2*j,0,c2*j,m ];
//------------------------------------
LP  = Point.ByCoordinates (x<1>, y, 0);
LF  = List.Flatten ( LP , 1 );
LV  = LF[i];
Eii = Line.ByBestFitThroughPoints(LV);
Pin = PolyCurve.ByPoints (LV, 1);
Pio = Pin.Offset(-e);
ke  = ["L","P","H","e","Pin","Pio", "Eii" ];
va  = [ l , p , h , e , Pin , Pio ,  Eii  ];
Dic = Dictionary.ByKeysValues(ke, va);
# ----------------------------------------
escalar_topo_1_seção_reta = DoubleSlider(0.2, range=0.2..1 step 0.05)
deslocar_inclinação_0_vertical = DoubleSlider(2.15, range=0..5 step 0.05)
categories = Categories("OST_BridgeAbutments")
modelar = BoolSelector(true)
quantidade_de_estai = DoubleSlider(15, range=5..15 step 1)
largura_total_tabuleiro = DoubleSlider(10, range=10..15 step 0.25)
altura_do_tabuleiro = DoubleSlider(1, range=1..2 step 0.25)
espessura_do_tabuleiro = DoubleSlider(0.25, range=0.25..0.6 step 0.05)
seção_superior_e_mastro = CodeBlock(Dic=seção_inferior_do_mastro.Dic, esc=escalar_topo_1_seção_reta, des=deslocar_inclinação_0_vertical, cat=categories, mod=modelar, qes=quantidade_de_estai, lt=largura_total_tabuleiro, ht=altura_do_tabuleiro, et=espessura_do_tabuleiro)
# ---------- seção_superior_e_mastro.designscript (24 lines) ----------
Dic;
esc;
des;
cat;
mod;
qes;
lt;
ht;
et;
Pin = Dic["Pin"];
L   = Dic["L"  ];
H   = Dic["H"  ];
e   = Dic["e"  ];
m   = L * -des;
//------------------------------------
Psu = Geometry.Scale ( Pin  , esc  );
Ps2 = Psu.Translate  ( m , 0 , H   );
Po2 = Ps2.Offset     ( -e          );
sol = Solid.ByLoft   ( [Pin , Ps2] );
//------------------------------------
mas = Mastro ( mod , sol , cat );
cab = Estais ( Pin , Ps2 , qes );
ptc = List.Flatten(cab[3], 2);
Pista ( lt, ht , et , ptc );
# ----------------------------------------
solidifica_o_mastro = CodeBlock()
# ---------- solidifica_o_mastro.designscript (10 lines) ----------
//------------------------------------------------------
//  Verificar que o material "Concreto" exista
//------------------------------------------------------
def Mastro(f,g,c)
{
    m = Material.ByName("Concreto");
    n = "Mastro";
    d = f ? DirectShape.ByGeometry(g,c,m,n) : 0;
    return d;
};
# ----------------------------------------
marcação_de_estai = CodeBlock()
# ---------- marcação_de_estai.designscript (28 lines) ----------
//-----------------------------------------------------
//  Harpa de estai
//-----------------------------------------------------
def Estais( p , q , n)
{
    p1  = PolyCurve.Points( p )[7];
    p2  = PolyCurve.Points( q )[7];
    p3  = Point.Translate ( p1 , di*1 , 0 , 0 );
    p4  = Point.Translate ( p3 , di*3 , 0 , 0 );
//-----------------------------------------------------
// Posicionamento do eixo dos cabos no mastro
//-----------------------------------------------------
    ex  = Line.ByStartPointEndPoint ( p1 , p2 );
    di  = ex.Length / 2.1;
    ta  = ex.TangentAtParameter ( 0.0);
    pm  = ex.PointAtParameter   ( 0.5);
//-----------------------------------------------------
// Posicionamento da Harpa
//-----------------------------------------------------
    ha1 = Line.ByStartPointDirectionLength ( pm,ta,di);
    ha2 = Line.ByStartPointEndPoint        ( p3,p4   );
    ph1 = Line.PointAtParameter(ha1 , 0..1..#n);
    ph2 = Line.PointAtParameter(ha2 , 0..1..#n);
    est = Line.ByStartPointEndPoint( ph1 , ph2);


    return [ ha1, ha2 , ph1, ph2, est];
};
# ----------------------------------------
code_block = CodeBlock()
# ---------- code_block.designscript (28 lines) ----------
//-------------------------------------------
//  Pista
//-------------------------------------------
def Pista ( l , h , et , pt )
{

    f   = 0.050;
    m   = 0.500;
    i   = [1,2,7,11,8,4];
    o   = Point.Origin( );
    v   = Vector.YAxis( );
    PM  = Plane.ByOriginNormal ( o , v );
    //---------------------------------------
    y   = l * [-m,   -f  ,  0 ,  f   , m];
    z   = h * [ 0, -0.25*m, -m , -2*m   ];
    //---------------------------------------
    LP  = Point.ByCoordinates ( 0, y<1>, z );
    LF  = List.Flatten        ( LP , 1     );
    LV  = LF[i];
    TD  = PolyCurve.ByPoints  ( LV , 1     );
    TE  = TD.Mirror   (  PM  );
    TID = TD.Offset   ( -et  );
    TIE = TE.Offset   ( -et  );
    PE  = TE.Translate( pt.AsVector( ));
    PD  = TD.Translate( pt.AsVector( ));

    return [ TD, TE, TID, TIE, PE, PD ];
};
# ----------------------------------------
