# Dynamo graph Paraboloide_Midi.dyn (Dynamo 2.17.1.4055)

zero = TimeSpan.Zero()
now = DateTime.Now()
timeOfDay = DateTime.TimeOfDay(dateTime=now)
add = TimeSpan.Add(timeSpan1=zero, timeSpan2=timeOfDay)
constroi_a_matriz_plana = CodeBlock(tempo=add)
# ---------- constroi_a_matriz_plana.designscript (15 lines) ----------
tempo;
//---------------------------------------------------
// Converte em string o Tempo Atual e separa miliseg.
//---------------------------------------------------
max  = 12;
mx   = max/2;
mili = String.Substring ( tempo+"" , 9 , 4);
s    = (String.ToNumber ( mili ) % max )+ 1;
x    = (-mx..mx)* s * Math.Random(s);
y    = (-mx..mx)* s * Math.Random(s);
pt   = Point.ByCoordinates ( x<1> , y);
z1   = (0..max) * s * Math.Random(s);
z2   = (max..0) * s;
p1   = pt[ 0].Translate ( 0 , 0 , z1);
p2   = pt[-1].Translate ( 0 , 0 , z2);
# ----------------------------------------
code_block = CodeBlock { 0; }
MIDI_Ativar = Musica_2020.Musica_2020.MIDI_Ativar(n=code_block)
revit_uia = Python()  # CPython3
# ---------- revit_uia.python (20 lines) ----------
import clr
import Revit

clr.AddReference("ProtoGeometry")
clr.AddReference("RevitAPI")
clr.AddReference("RevitAPIUI")
clr.AddReference("RevitServices")
clr.AddReference("RevitNodes")

from Autodesk.DesignScript.Geometry import *
from Autodesk.Revit.DB import *
from RevitServices.Persistence import DocumentManager


#dad = IN[0]

doc = DocumentManager.Instance.CurrentDBDocument
uia = DocumentManager.Instance.CurrentUIApplication

OUT = uia
# ----------------------------------------
tocar = CodeBlock(max=constroi_a_matriz_plana.max, s=constroi_a_matriz_plana.s, p1=constroi_a_matriz_plana.p1, p2=constroi_a_matriz_plana.p2, midi=MIDI_Ativar, app=revit_uia)
# ---------- tocar.designscript (45 lines) ----------
max;
s;
p1;
p2;
midi;
app;

gx = Line.ByStartPointEndPoint ( p1    ,   p2   );
gy = Line.ByStartPointEndPoint ( px[0] , px[-1] );
px = Line.PointAtParameter     ( gx<1> , 0..1..#max+1);
py = List.Transpose ( px );

nx = List.Flatten( Math.Floor ( px.Z ), 1);
ny = List.Flatten( Math.Floor ( py.Z ), 1);

cro = [ 0, 1, 2, 3, 4, 5, 6, 7, 8, 9, 10, 11     ]+1+s%3;
mox = [ 0, 2, 2, 3, 5, 7, 0, 8, 8, 10, 7, 3]+1+s%3;
moy = mox - 12+7;
melx = mox;
mely = moy;

//-----------------------------------------------------------
// 1.1 a 1.5
//-----------------------------------------------------------
pulso = 10500;
andam = 1.5;
dur   = Math.Floor ( pulso / Math.Pow( max , andam ));
//-----------------------------------------------------------
// Se aumentar dur, aumentar o período para completar ciclo
//-----------------------------------------------------------
f   = s%2? 66 : 64;
mx   = List.Count ( melx  )-1;
my   = List.Count ( mely  )-1;
ax  = nx % mx;
ay  = ny % my;
sx  = List.ShiftIndices( melx , (s%4)+1)[ax];
sy  = List.ShiftIndices( melx , (s%4)+1)[ax];
//-----------------------------------------------------------
// Tocar Midi
//-----------------------------------------------------------
qp  = List.Count(sx);
azi = 0..405..#qp;
alt = 0.. 90..#qp;
din = 120;
Musica_2020.Tocar_Cruza( app,midi,f,sx,sy,dur,din,1,9,3,azi,alt);
# ----------------------------------------
watch = Watch(tocar.dur)
watch_2 = Watch(tocar.sy)
